# Grasshopper definition FlexiArchScript.gh (Grasshopper 1.0.7)
# plug-ins: Human, ClimateStudioGH

cluster = Cluster()
# 0. Layer - Object Referencing
# Please note: The objects on each layer in Rhino
# have to follow the specified geometry type
# for the script to work. Toggle the button to read in your Rhino geometry,
# Required Components:
# LunchBox (Layer Managment)
# Climate Studio (Daylight)
reference_layer_objects = ReferenceLayerObjects(toggle=Toggle(True))  # -> l0, l1, l2, l3, l4, l5, l6, l7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
# 1. Calculate Individual Flexibility Scores
# Toggle the button to run the Flexibility calculations.
# You don't need to do any additional work at this step.
#  If you get an error here, please check that
#  you followed the layer and 3D modelling
# convention specified in the Rhino Layers.
# Parameters inspiredby (Cavalliere et al. 2019)
# Parameters Inspired by (Geraedts, 2016)
run = Button()

# ----
# Percent/Orientation of Windows
percent_orientation_windows = PercentOrientationWindows(
    non_operable_windows=reference_layer_objects.l6,
    operable_windows=reference_layer_objects.l5,
    srf=reference_layer_objects.l0)  # -> flatten(R)

# ----
# Structural Modularity
structural_modularity = StructuralModularity(brep=reference_layer_objects.l7)  # -> flatten(R)

# ----
# Geometrical Regularity
geometrical_regularity = GeometricalRegularity(brep=reference_layer_objects.l0)  # -> flatten(A)

# ----
# Location of Technical Services
location_technical_services = LocationTechnicalServices(G_2=reference_layer_objects.l0, G=reference_layer_objects.l11)  # -> flatten(A)

# ----
# Floor-to-ceiling Height
floor_ceiling = FloorCeiling(floor=reference_layer_objects.l0, celing=reference_layer_objects.l1)  # -> flatten(i)

# ----
# Obstacles in Floorplan
obstacles = Obstacles(floor=reference_layer_objects.l0, columns=reference_layer_objects.l7)  # -> flatten(R)

# ----
# Percent of Internal Mobile Partitions
percentage_of_movable_partitions = PercentageOfMovablePartitions(
    amp_is_the_total_area_of_the_mobile_part=reference_layer_objects.l4,
    ap_is_the_total_area_of_the_partition_wa=reference_layer_objects.l3)  # -> flatten(R)

# ----
# Percent of Operable Windows
operablewindows = OperableWindows(nonoperablewindows=reference_layer_objects.l6, operablewindows=reference_layer_objects.l5)  # -> flatten(R)

# ----
# Entry Points
entry_points = EntryPoints(entrydoors=reference_layer_objects.l8)  # -> flatten(entrypointscore)

# ----
# Percent of Removable Building Elements
removable_elements = RemovableElements(non_load_bearing=reference_layer_objects.l3, load_bearing=reference_layer_objects.l2)  # -> flatten(R)

# ----
# Daylight Availability
daylight = Daylight(
    ceiling=reference_layer_objects.l1,
    floor=reference_layer_objects.l0,
    walls=[reference_layer_objects.l3, reference_layer_objects.l2],
    windows=[reference_layer_objects.l5, reference_layer_objects.l6],
    run=run)  # -> flatten(spatial_daylight_autonomy), grid_preview
previewgrid = PreviewCSSensorGrid(
    Grid=daylight.grid_preview,
    Metric="Daylight Autonomy (SensorArray) [fraction of time]",
    Input_0_Hidden=False,
    Input_0_Name="Grid",
    Input_1_Hidden=False,
    Input_1_Name="Metric",
    Input_2_Hidden=True,
    Input_2_Name="Falsecolor",
    Input_3_Hidden=True,
    Input_3_Name="Sensor Values",
    Input_4_Hidden=True,
    Input_4_Name="Show Points",
    Input_5_Hidden=True,
    Input_5_Name="Show Edges",
    Input_6_Hidden=True,
    Input_6_Name="Show Labels",
    Input_7_Hidden=True,
    Input_7_Name="Label Format",
    Input_8_Hidden=True,
    Input_8_Name="Transform",
    Output_0_Hidden=True,
    Output_0_Name="Mesh",
    Output_1_Hidden=True,
    Output_1_Name="Texture",
    UnitSystem=4,
    Input_4_GHParam_Branch0_Path="{0}",
    Input_4_GHParam_Branch0_Item0_boolean=True,
    Input_5_GHParam_Branch0_Path="{0}",
    Input_5_GHParam_Branch0_Item0_boolean=True,
    Input_6_GHParam_Branch0_Path="{0}",
    Input_6_GHParam_Branch0_Item0_boolean=False)

panel = Panel(geometrical_regularity)
panel_2 = Panel(floor_ceiling)
panel_3 = Panel(location_technical_services)
panel_4 = Panel(percent_orientation_windows)
# Individual
# Flexibility
# Scores
panel_5 = Panel(structural_modularity)
panel_6 = Panel(removable_elements)
panel_7 = Panel(entry_points)
panel_8 = Panel(obstacles)
panel_9 = Panel(percentage_of_movable_partitions)
panel_10 = Panel(operablewindows)
panel_11 = Panel(daylight.spatial_daylight_autonomy)
# Weights
panel_12 = Panel("0.0956")
c_score_names = CSharpScript()  # -> out, A
# ---------- c_score_names: C# ----------
    List<string> scores = new List<string>();
    scores.Add("Structural Modularity");
    scores.Add("Geometrical Regularity");
    scores.Add("Location Technical Services");
    scores.Add("Percent/Orientation Windows");
    scores.Add("Floor to Ceiling Height");
    scores.Add("Obstacles Floor Plan");
    scores.Add("Internal Mobile Partitions");
    scores.Add("Percent Operable Windows");
    scores.Add("Daylight Availability");
    scores.Add("Entry Points");
    scores.Add("Removable Elements");
    scores.Add("Total Flexibility");

    A = scores;
# ---------- end c_score_names ----------
area = Area(Geometry=reference_layer_objects.l0)  # -> Area, Centroid
move = Move(Geometry=area.Centroid, Motion="{-8,-8,0}")  # -> Geometry, Transform
pdecon = Deconstruct(Point=move.Geometry)  # -> XComponent, YComponent, ZComponent

merge = Merge(
    Data1=panel_12,
    Data2="0.1011",
    Data3="0.0871",
    Data4="0.0888",
    Data5="0.0915",
    Data6="0.1010",
    Data7="0.0872",
    Data8="0.0859",
    Data9="0.0871",
    Data10="0.0850",
    Data11="0.0896")  # -> flatten(Result)
# TOTAL FLEXIBILITY
individual_flexibility_factor_scores = Merge(
    Data1=structural_modularity,
    Data2=geometrical_regularity,
    Data3=location_technical_services,
    Data4=percent_orientation_windows,
    Data5=floor_ceiling,
    Data6=obstacles,
    Data7=percentage_of_movable_partitions,
    Data8=operablewindows,
    Data9=daylight.spatial_daylight_autonomy,
    Data10=entry_points,
    Data11=removable_elements)
wav = WeightedAverage(Input=individual_flexibility_factor_scores, Weights=merge)
weighted_total_flexibility_score = Panel(wav)

ma = MassAddition(Input=individual_flexibility_factor_scores)  # -> Result, PartialResults
division = Division(A=ma.Result, B="11")

unweighted_total_flexibility_score = Panel(division)

# ----
# 2. Printing Flexibility Scores To Rhino Canvas
# Convert Score to Percentage
all_scores = Merge(Data1=individual_flexibility_factor_scores, Data2=wav)

multiplication = Multiplication(A=all_scores, B="100")
round = Round(Number=multiplication)  # -> Nearest, Floor, Ceiling
concat = Concatenate(FragmentA=round.Nearest, FragmentB="%")

concat_2 = Concatenate(FragmentA=c_score_names.A, FragmentC=": ", FragmentB=concat)

# ----
# Print Scores on Rhino Canvas
panel_13 = Panel("0 To -10")
range = Range(Domain=panel_13, Steps="11")
range_2 = Range(Domain="0 To 10", Steps="11")

addition = Addition(A=pdecon.YComponent, B=range_2)
addition_2 = Addition(A=pdecon.XComponent, B=range)

pt = ConstructPoint(XCoordinate=addition_2, YCoordinate=addition, ZCoordinate=0)
screentext = ScreenOrientedText(
    Text=concat_2,
    Font="Helvetica",
    Justification=7,
    Location=pt,
    SizeFactor=Slider(20, range=0..100),
    Depth=0,
    Absolute=False)

# ==== cluster ReferenceLayerObjects
toggle = ClusterInput()
layer_info = LayerInformation(ReferenceToggle=toggle)  # -> simplify(Names), DisplayColors, GUID
layer_ref = LayerReference(ReferenceToggle=toggle, LayerName=layer_info.Names)  # -> simplify(Geometry), Name, UserStrings, GUID
branch = TreeBranch(Tree=layer_ref.Geometry, Path="10", MaintainPaths=True)
branch_2 = TreeBranch(Tree=layer_ref.Geometry, Path="11", MaintainPaths=True)
item = ListItem(List=layer_info.Names, Index="10", Wrap=True)
item_2 = ListItem(List=layer_info.Names, Index="11", Wrap=True)
branch_3 = TreeBranch(Tree=layer_ref.Geometry, Path="9", MaintainPaths=True)
branch_4 = TreeBranch(Tree=layer_ref.Geometry, Path="0", MaintainPaths=True)
branch_5 = TreeBranch(Tree=layer_ref.Geometry, Path="8", MaintainPaths=True)
item_3 = ListItem(List=layer_info.Names, Index="9", Wrap=True)
item_4 = ListItem(List=layer_info.Names, Index="0", Wrap=True)
branch_6 = TreeBranch(Tree=layer_ref.Geometry, Path="3", MaintainPaths=True)
branch_7 = TreeBranch(Tree=layer_ref.Geometry, Path="7", MaintainPaths=True)
item_5 = ListItem(List=layer_info.Names, Index="8", Wrap=True)
branch_8 = TreeBranch(Tree=layer_ref.Geometry, Path="1", MaintainPaths=True)
branch_9 = TreeBranch(Tree=layer_ref.Geometry, Path="4", MaintainPaths=True)
branch_10 = TreeBranch(Tree=layer_ref.Geometry, Path="2", MaintainPaths=True)
item_6 = ListItem(List=layer_info.Names, Index="3", Wrap=True)
branch_11 = TreeBranch(Tree=layer_ref.Geometry, Path="6", MaintainPaths=True)
item_7 = ListItem(List=layer_info.Names, Index="7", Wrap=True)
item_8 = ListItem(List=layer_info.Names, Index="1", Wrap=True)
item_9 = ListItem(List=layer_info.Names, Index="4", Wrap=True)
item_10 = ListItem(List=layer_info.Names, Index="2", Wrap=True)
branch_12 = TreeBranch(Tree=layer_ref.Geometry, Path="5", MaintainPaths=True)
item_11 = ListItem(List=layer_info.Names, Index="6", Wrap=True)
item_12 = ListItem(List=layer_info.Names, Index="5", Wrap=True)
panel = Panel(item_4)
panel_2 = Panel(branch_4)
panel_3 = Panel(item)
panel_4 = Panel(branch)
panel_5 = Panel(item_2)
panel_6 = Panel(branch_2)
panel_7 = Panel(item_8)
panel_8 = Panel(item_6)
panel_9 = Panel(branch_6)
panel_10 = Panel(branch_8)
panel_11 = Panel(item_10)
panel_12 = Panel(item_9)
panel_13 = Panel(branch_9)
panel_14 = Panel(item_5)
panel_15 = Panel(item_3)
panel_16 = Panel(branch_3)
panel_17 = Panel(branch_10)
panel_18 = Panel(item_7)
panel_19 = Panel(branch_5)
panel_20 = Panel(item_11)
panel_21 = Panel(branch_7)
panel_22 = Panel(item_12)
panel_23 = Panel(branch_11)
panel_24 = Panel(branch_12)
l7 = ClusterOutput(branch_7)  # L7
l6 = ClusterOutput(branch_11)  # L6
l5 = ClusterOutput(branch_12)  # L5
l8 = ClusterOutput(branch_5)  # L8
l11 = ClusterOutput(branch_2)  # L11
l2 = ClusterOutput(branch_10)  # L2
l4 = ClusterOutput(branch_9)  # L4
l3 = ClusterOutput(branch_6)  # L3
l9 = ClusterOutput(branch_3)  # L9
l0 = ClusterOutput(branch_4)  # L0
l1 = ClusterOutput(branch_8)  # L1
l10 = ClusterOutput(branch)  # L10

# ==== cluster StructuralModularity
brep = ClusterInput()
brep_2 = Brep(brep)
center = Center(Geometry=brep_2)  # -> Center, Dimension
c_script = CSharpScript(pts=center.Center)  # -> out, X, Y, Z; inputs pts: list of Point3d
# ---------- c_script: C# ----------
    int len = pts.Count;

    List<double> xs = new List<double>();
    List<double> ys = new List<double>();
    List<double> zs = new List<double>();
    
    for (int i = 0; i < len; i++)
    {
      xs.Add(pts[i].X);
      ys.Add(pts[i].Y);
      zs.Add(pts[i].Z);

    }
    
    X = xs;
    Y = ys;
    Z = zs;
# ---------- end c_script ----------
sort_pt = SortPoints(Points=center.Center)  # -> flatten(Points), Indices
sort = SortList(Keys=c_script.Y, ValuesA=center.Center)  # -> Keys, ValuesA
sort_2 = SortList(Keys=c_script.X, ValuesA=center.Center)  # -> Keys, ValuesA
sort_val = SortDuplicateValues(ValueList=sort.Keys)  # -> UniqueValues, Indices
sort_val_2 = SortDuplicateValues(ValueList=sort_2.Keys)  # -> UniqueValues, simplify(Indices)

# ---- group: Uniformity of Structure Along Y axis
sort_3 = SortList(Keys=sort_val.UniqueValues)  # -> Keys, ValuesA
c_script_2 = CSharpScript(coords=sort_3.Keys)  # -> out, A, B, C; inputs coords: list of Double
# ---------- c_script_2: C# ----------
    int len = coords.Count;

    List<double> spans = new List<double>();


    double avg = 0;

    for (int i = 1; i < len; i++)
    {
      double dist = coords[i] - coords[i - 1];
      spans.Add(coords[i] - coords[i - 1]);
      avg = avg + dist;

    }
    avg = avg / (len - 1);


    double error = 0;

    for (int k = 1; k < len; k++)
    {
      double dist = coords[k] - coords[k - 1];
      double err = Math.Abs(avg - dist);
      error = error + err;
    }

    error = error / (len - 1);

    A = spans;
    B = avg;
    C = error;
# ---------- end c_script_2 ----------
panel = Panel(c_script_2.C)
panel_2 = Panel(c_script_2.A)

# ---- group: Uniformity of Structure Along X Axis
sort_4 = SortList(Keys=sort_val_2.UniqueValues)  # -> Keys, ValuesA
c_script_3 = CSharpScript(coords=sort_4.Keys)  # -> out, A, B, C; inputs coords: list of Double; same code as c_script_2
panel_3 = Panel(c_script_3.C)
panel_4 = Panel(c_script_3.A)

# ---- group: Extract Points form List that Are unique
c_script_4 = CSharpScript(xIndices=sort_val.Indices)  # -> out, A; inputs xIndices: tree of Int32
# ---------- c_script_4: C# ----------
    int numBranches = xIndices.BranchCount;

    List<int> index = new List<int>();

    for (int i = 0; i < numBranches; i++)
    {
      List<int> list = xIndices.Branch(i);
      if (list.Count == 1){index.Add(list[0]);}

    }

    A = index;
# ---------- end c_script_4 ----------

c_script_5 = CSharpScript(xIndices=sort_val_2.Indices)  # -> out, A; inputs xIndices: tree of Int32; same code as c_script_4

# ---- group: Measure Distance Between unique point to previous and sucessive
item = ListItem(List=sort.ValuesA, Index=graft(c_script_4.A), Wrap=True)  # -> Item1, Item, Item1_2
dist = Distance(PointA=item.Item1, PointB=item.Item)
dist_2 = Distance(PointA=item.Item, PointB=item.Item1_2)

item_2 = ListItem(List=sort_2.ValuesA, Index=graft(c_script_5.A), Wrap=True)  # -> Item1, Item, Item1_2
dist_3 = Distance(PointA=item_2.Item1, PointB=item_2.Item)
dist_4 = Distance(PointA=item_2.Item, PointB=item_2.Item1_2)

# ---- group: Subtract Largest from Smallest Distance
num = Number([dist, dist_2])
sort_5 = SortList(Keys=num)  # -> Keys, ValuesA
item_3 = ListItem(List=sort_5.Keys, Index=0, Wrap=True)  # -> Item, Item1
subtraction = Subtraction(A=item_3.Item1, B=item_3.Item)

num_2 = Number([dist_3, dist_4])
sort_6 = SortList(Keys=num_2)  # -> Keys, ValuesA
item_4 = ListItem(List=sort_6.Keys, Index=0, Wrap=True)  # -> Item, Item1
subtraction_2 = Subtraction(A=item_4.Item1, B=item_4.Item)

# ---- group: Average Distance of structure from Grid
# Y Distance from Grid
avr = Average(Input=subtraction)

# X Distance from Grid
avr_2 = Average(Input=subtraction_2)

# ----
# Average Span in this Structure
avr_3 = Average(Input=flatten([c_script_3.B, c_script_2.B]))

# ----
# Average Structural Regularity of Grid
avr_4 = Average(Input=flatten([c_script_3.C, c_script_2.C]))

# ----
# Average Structural Non-Regularity of Grid
avr_5 = Average(Input=flatten([avr, avr_2]))

# ----
# Normalized based on Buildings Structure Grid
avr_6 = Average(Input=flatten(avr_4))
division = Division(A=avr_6, B=avr_3)

subtraction_3 = Subtraction(A="1", B=division)
R = ClusterOutput(subtraction_3)

# ==== cluster EntryPoints
# The more entrances to the apartment, the more flexibility in changing subdivisions,catering to different user groups, etc.
entrydoors = ClusterInput()
c_script = CSharpScript(entryDoors=entrydoors)  # -> out, entryPointScore; inputs entryDoors: list of Surface
# ---------- c_script: C# ----------
    int numDoors = entryDoors.Count;

    double doorScore;
    if (numDoors <= 1){doorScore = 0.5;}
    else {doorScore = 1;}


    entryPointScore = doorScore;
# ---------- end c_script ----------
entrypointscore = ClusterOutput(c_script.entryPointScore)

# ==== cluster FloorCeiling
# The heigher the floor to ceiling height, the more ways the apartment can be rearranged.
floor = ClusterInput()
celing = ClusterInput()
floor_2 = Surface(floor)
celing_2 = Surface(celing)
center = Center(Geometry=floor_2)  # -> Center, Dimension
srf_cp = SurfaceClosestPoint(Point=center.Center, Surface=celing_2)  # -> Point, UVPoint, Distance
dist = Distance(PointA=center.Center, PointB=srf_cp.Point)
c_script = CSharpScript(floorHeight=dist)  # -> out, floorHeightScore; inputs floorHeight: Double
# ---------- c_script: C# ----------
    double heightScore = 0;
    if (floorHeight <= 2.6){ heightScore = 0.33;}
    else if (floorHeight <= 3.0 ){heightScore = 0.66;}
    else if (floorHeight > 3.0 ){heightScore = 1;}

    floorHeightScore = heightScore;
# ---------- end c_script ----------
item = ListItem(List=c_script.floorHeightScore, Index=0, Wrap=True)
i = ClusterOutput(item)

# ==== cluster Obstacles
columns = ClusterInput()
# The less obstructions in the floor plan from structural elements such as columns, the better.
floor = ClusterInput()
columns_2 = Brep(columns)
floor_2 = Surface(floor)
center = Center(Geometry=graft(columns_2))  # -> Center, Dimension
edges = BrepEdges(Brep=floor_2)  # -> Naked, Interior, NonManifold
project = ProjectPoint(Point=center.Center, Direction=Vector(0, 0, -1), Geometry=floor_2)  # -> Point, Index
join = JoinCurves(Curves=edges.Naked, Preserve=False)
offset = OffsetCurve(Curve=join, Distance="-.5", Corners=1)
incurve = PointInCurve(Point=project.Point, Curve=offset)  # -> flatten(Relationship), Point
equals = Equality(FirstNumber=incurve.Relationship, SecondNumber="2")  # -> Equality, Inequality
cull = CullPattern(List=incurve.Relationship, CullPattern=equals.Equality)
lng = ListLength(List=flatten(project.Point))
lng_2 = ListLength(List=cull)
division = Division(A=lng_2, B=lng)
remap = RemapNumbers(Value=division, Source=Domain(0, 1), Target="1 To 0")  # -> Mapped, Clipped
R = ClusterOutput(remap.Mapped)

# ==== cluster OperableWindows
# The heigher the percentage of operable windows, the better the design.
nonoperablewindows = ClusterInput()
operablewindows = ClusterInput()
nonoperablewindows_2 = Surface(nonoperablewindows)
operablewindows_2 = Surface(operablewindows)
lng = ListLength(List=operablewindows_2)
lng_2 = ListLength(List=nonoperablewindows_2)
addition = Addition(A=lng_2, B=lng)
division = Division(A=lng, B=addition)
R = ClusterOutput(division)

# ==== cluster GeometricalRegularity
brep = ClusterInput()
brep_2 = Brep(brep)

# ---- group: A. Ratio between circumscribed rectangle is <4
edges = BrepEdges(Brep=brep_2)  # -> Naked, Interior, NonManifold
item = ListItem(List=edges.Naked, Index=0, Wrap=True)  # -> Item, Item1
crv_x_dir = Curve(item.Item)
crv_y_dir = Curve(item.Item1)
len = Length(Curve=crv_y_dir)
len_2 = Length(Curve=crv_x_dir)
division = Division(A=len_2, B=len)
smaller = SmallerThan(FirstNumber=division, SecondNumber="4")  # -> SmallerThan, OrEqualTo
larger = LargerThan(FirstNumber=division, SecondNumber="0.25")  # -> LargerThan, OrEqualTo
and = GateAnd(A=smaller.SmallerThan, B=larger.LargerThan)

# ----
runion = RegionUnion(Curves=brep_2)

# ---- group: B.Compact form of plan - Circumscribed area isn't more than 5% larger than area
area = Area(Geometry=brep_2)  # -> Area, Centroid
area_2 = Area(Geometry=runion)  # -> Area, Centroid
subtraction = Subtraction(A=area.Area, B=area_2.Area)
division_2 = Division(A=subtraction, B=area.Area)
B = SecondNumber(0.05)
smaller_2 = SmallerThan(FirstNumber=division_2, SecondNumber=B)  # -> SmallerThan, OrEqualTo

# ---- group: C. Symmetry - distace between centers
data = Data(area.Centroid)
data_2 = Data(area_2.Centroid)
dist = Distance(PointA=data, PointB=data_2)

# ----
c_script = CSharpScript(bool1=and, bool2=smaller_2.OrEqualTo, xOverY=division, aMax=area.Area, aActual=area_2.Area, cenDist=dist)  # -> out, A; inputs bool1: Boolean, bool2: Boolean, xOverY: Double, aMax: Double, aActual: Double, cenDist: Double
# ---------- c_script: C# ----------
    double res = 0;

    double y1 = 0.375;
    double y2 = 0.375;
    double y3 = 0.25;
    if (bool1 == true && bool2 == true)
    {

      //res = y1 * (1 - (xOverY * 0.25)) + y2 * (1 - ((1 / 0.05) * (aMax / aActual))) + y3 * (1 - 0.5 * (cenDist));
      res = y1 * (1 - (xOverY * 0.25)) + y2 * (aActual / aMax) + y3 * (1 - (cenDist));
    }
    else {res = 0;}

    A = res;
# ---------- end c_script ----------
A = ClusterOutput(c_script.A)

# ==== cluster LocationTechnicalServices
G = ClusterInput()
center = Center(Geometry=G)  # -> Center, Dimension
xy = XYPlane(Origin=Point(0, 0, 0))
project = Project(Geometry=center.Center, Plane=xy)  # -> Geometry, Transform
G_2 = ClusterInput()
bbox = BoundingBox(Content=G_2, Plane=PlaneXY(0, 0, 0))  # -> Box, Box_2

bbox_2 = BoundingBox(Content=G_2, Plane=PlaneXY(0, 0, 0))  # -> Box, Box_2
debox = DeconstructBox(Box=bbox_2.Box)  # -> Plane, X, Y, Z
dedomain = DeconstructDomain(Domain=debox.Y)  # -> Start, End
dedomain_2 = DeconstructDomain(Domain=debox.X)  # -> Start, End
subtraction = Subtraction(A=dedomain_2.End, B=dedomain_2.Start)  # -> graft(Result)
subtraction_2 = Subtraction(A=dedomain.End, B=dedomain.Start)  # -> graft(Result)
sqr = Square(Value=subtraction_2)
sqr_2 = Square(Value=subtraction)
addition = Addition(A=sqr_2, B=sqr)
sqrt = SquareRoot(Value=addition)  # -> flatten(Result)
panel = Panel(sqrt)

edges = BrepEdges(Brep=bbox.Box)  # -> Naked, Interior, NonManifold
item = ListItem(List=edges.Naked, Index=0, Wrap=True)  # -> Item, Item1

center_2 = Center(Geometry=G_2)  # -> Center, Dimension
c_script = CSharpScript(centerOfPlan=center_2.Center, services=project.Geometry, x=subtraction, y=subtraction_2, n="1")  # -> out, A, B; inputs centerOfPlan: Point3d, services: list of Point3d, x: Int32, y: Int32, n: Int32
# ---------- c_script: C# ----------
    //xC is the distance between the barycentre of the shaft and the barycentre of the housing plan in x-direction;
    //yC is the distance between the barycentre of the shaft and the barycentre of the housing plan in y - direction;

    int len = services.Count;

    double avg = 0;

    for (int i = 0; i < len; i++)
    {

      Point3d centerOfServices = services[i];

      double XC = Math.Abs(centerOfPlan.X - centerOfServices.X);
      double YC = Math.Abs(centerOfPlan.Y - centerOfServices.Y);

      double dist = (1 - ( 0.5 * (XC / (x / 2)) + 0.5 * (YC / (y / 2))));
      avg = avg + dist;
    }

    avg = avg / (len );

    A = avg;
    B = len;
# ---------- end c_script ----------

crv_x_dir = Curve(item.Item)
crv_y_dir = Curve(item.Item1)
len = Length(Curve=crv_y_dir)
len_2 = Length(Curve=crv_x_dir)
A = ClusterOutput(c_script.A)

# ==== cluster RemovableElements
non_load_bearing = ClusterInput()
load_bearing = ClusterInput()
non_load_bearing_2 = Geometry(non_load_bearing)
load_bearing_2 = Geometry(load_bearing)
area = Area(Geometry=non_load_bearing_2)  # -> Area, Centroid
area_2 = Area(Geometry=load_bearing_2)  # -> Area, Centroid
ma = MassAddition(Input=area_2.Area)  # -> Result, PartialResults
ma_2 = MassAddition(Input=area.Area)  # -> Result, PartialResults
division = Division(A=ma_2.Result, B=ma.Result)
R = ClusterOutput(division)

# ==== cluster PercentageOfMovablePartitions
ap_is_the_total_area_of_the_partition_wa = ClusterInput()  # "Ap is the total area of the partition walls"
amp_is_the_total_area_of_the_mobile_part = ClusterInput()  # "Amp is the total area of the mobile partition walls"
ap_is_the_total_area_of_the_partition_wa_2 = Data(ap_is_the_total_area_of_the_partition_wa)  # "Ap is the total area of the partition walls"
amp_is_the_total_area_of_the_mobile_part_2 = Data(amp_is_the_total_area_of_the_mobile_part)  # "Amp is the total area of the mobile partition walls"
lng = ListLength(List=amp_is_the_total_area_of_the_mobile_part_2)
lng_2 = ListLength(List=ap_is_the_total_area_of_the_partition_wa_2)
expression = Expression(Amp=lng, Ap=lng_2, Expression="Amp/Ap")
R = ClusterOutput(expression)

# ==== cluster PercentOrientationWindows
operable_windows = ClusterInput()
non_operable_windows = ClusterInput()
non_operable_windows_2 = Surface(non_operable_windows)
operable_windows_2 = Surface(operable_windows)
srf = ClusterInput()

bbox = BoundingBox(Content=operable_windows_2, Plane=PlaneXY(0, 0, 0))  # -> Box, Box_2
debox = DeconstructBox(Box=bbox.Box)  # -> Plane, X, Y, Z
dedomain = DeconstructDomain(Domain=debox.Y)  # -> Start, End
dedomain_2 = DeconstructDomain(Domain=debox.X)  # -> Start, End
subtraction = Subtraction(A=dedomain_2.End, B=dedomain_2.Start)  # -> graft(Result)
subtraction_2 = Subtraction(A=dedomain.End, B=dedomain.Start)  # -> graft(Result)
sqr = Square(Value=subtraction_2)
sqr_2 = Square(Value=subtraction)
addition = Addition(A=sqr_2, B=sqr)
sqrt = SquareRoot(Value=addition)  # -> flatten(Result)
panel = Panel(sqrt)
ma = MassAddition(Input=sqrt)  # -> Result, PartialResults

bbox_2 = BoundingBox(Content=non_operable_windows_2, Plane=PlaneXY(0, 0, 0))  # -> Box, Box_2
debox_2 = DeconstructBox(Box=bbox_2.Box)  # -> Plane, X, Y, Z
dedomain_3 = DeconstructDomain(Domain=debox_2.Y)  # -> Start, End
dedomain_4 = DeconstructDomain(Domain=debox_2.X)  # -> Start, End
subtraction_3 = Subtraction(A=dedomain_4.End, B=dedomain_4.Start)  # -> graft(Result)
subtraction_4 = Subtraction(A=dedomain_3.End, B=dedomain_3.Start)  # -> graft(Result)
sqr_3 = Square(Value=subtraction_4)
sqr_4 = Square(Value=subtraction_3)
addition_2 = Addition(A=sqr_4, B=sqr_3)
sqrt_2 = SquareRoot(Value=addition_2)  # -> flatten(Result)
panel_2 = Panel(sqrt_2)
ma_2 = MassAddition(Input=sqrt_2)  # -> Result, PartialResults

addition_3 = Addition(A=ma_2.Result, B=ma.Result)

srf_2 = Surface(operable_windows_2)
facen = FaceNormals(Mesh=srf_2)  # -> Centers, Normals
amp = Amplitude(Vector=facen.Normals, Amplitude="-1")
move = Move(Geometry=facen.Centers, Motion=facen.Normals)  # -> Geometry, Transform
move_2 = Move(Geometry=facen.Centers, Motion=amp)  # -> Geometry, Transform
pt = Point(move.Geometry)
pt_2 = Point(move_2.Geometry)

# ---- group: Floor PLan Outline
srf_3 = Surface(srf)
debrep = DeconstructBrep(Brep=srf_3)  # -> Faces, Edges, Vertices
join = JoinCurves(Curves=debrep.Edges, Preserve=False)

# ---- group: Floor Plan Perimeter
len = Length(Curve=join)

# ----
division = Division(A=addition_3, B=len)
R = ClusterOutput(division)

project = Project(Geometry=pt, Plane=srf_3)  # -> flatten(Geometry), Transform
project_2 = Project(Geometry=pt_2, Plane=srf_3)  # -> flatten(Geometry), Transform

# ---- group: Floor PLan Outline (continued)
incurve = PointInCurve(Point=project.Geometry, Curve=join)  # -> Relationship, Point

# ----
larger = LargerThan(FirstNumber=incurve.Relationship, SecondNumber="1")  # -> LargerThan, OrEqualTo
cull = CullPattern(List=srf_2, CullPattern=invert(larger.LargerThan))
flip = Flip(Surface=cull)  # -> Surface, Result
cull_2 = CullPattern(List=srf_2, CullPattern=larger.LargerThan)
srf_4 = Surface([cull_2, flip.Surface])
facen_2 = FaceNormals(Mesh=srf_4)  # -> Centers, Normals
c_script = CSharpScript(normals=flatten(facen_2.Normals))  # -> out, A; inputs normals: list of Vector3d
# ---------- c_script: C# ----------
    int len = normals.Count;

    int or1 = 0;
    int or2 = 0;
    int or3 = 0;
    int or4 = 0;

    Vector3d vec1 = new Vector3d(1, 0, 0);
    Vector3d vec2 = new Vector3d(0, 1, 0);
    Vector3d vec3 = new Vector3d(-1, 0, 0);
    Vector3d vec4 = new Vector3d(0, -1, 0);
    
    double numOrs = 0;

    for (int i = 0; i < len; i++)
    {
      Vector3d vec = normals[i];

      if (vec == vec1){or1 = 1;}
      else if (vec == vec2){or2 = 1;}
      else if (vec == vec3){or3 = 1;}
      else if (vec == vec4){or4 = 1;}
    }

    numOrs = or1 + or2 + or3 + or4;
    
    A = numOrs ;
# ---------- end c_script ----------

# ==== cluster Daylight
windows = ClusterInput()  # Windows
ceiling = ClusterInput()  # Ceiling
walls = ClusterInput()  # Walls
floor = ClusterInput()  # Floor
Z = UnitZ(Factor=Slider(1, range=0..1))
unit = CSUnitScale(
    From="Meters",
    To="ActiveRhinoDocUnits",
    Listener=True,
    Input_0_Hidden=False,
    Input_0_Name="From",
    Input_1_Hidden=False,
    Input_1_Name="To",
    Input_2_Hidden=False,
    Input_2_Name="Listener",
    UnitSystem=4)
move = Move(Geometry=floor, Motion=Z)  # -> Geometry, Transform
internalgeometry = InternalGeometry(F=unit)  # -> ceiling_3, floor_3, mullion_3, wall_3, glazing_3, grid_3
material = GetCSLightingMaterial(Search="ceiling lm83", UnitSystem=4)
material_2 = GetCSLightingMaterial(Search="floor lm83", UnitSystem=4)
material_3 = GetCSLightingMaterial(Search="wall lm83", UnitSystem=4)
glazing = GetCSGlazingAssembly(UnitSystem=4)
flip = Flip(Surface=floor)  # -> Surface, Result
grid = ConstructCSSensorGrid(
    Level="LEVEL 01",
    Id="1",
    Description="FloorPlan",
    Geometry=flip.Surface,
    Spacing=0.6096,
    Input_0_Hidden=True,
    Input_0_Name="Building",
    Input_10_Hidden=True,
    Input_10_Name="SupplementalLux",
    Input_11_Hidden=True,
    Input_11_Name="TargetLux",
    Input_12_Hidden=True,
    Input_12_Name="ExcessiveLux",
    Input_13_Hidden=True,
    Input_13_Name="sDA_Time",
    Input_14_Hidden=True,
    Input_14_Name="BREEAMSpaceType",
    Input_15_Hidden=True,
    Input_15_Name="ViewOffset",
    Input_16_Hidden=True,
    Input_16_Name="ViewDirections",
    Input_17_Hidden=True,
    Input_17_Name="ViewRotation",
    Input_18_Hidden=True,
    Input_18_Name="Points Override",
    Input_19_Hidden=True,
    Input_19_Name="Normals Override",
    Input_1_Hidden=False,
    Input_1_Name="Level",
    Input_20_Hidden=True,
    Input_20_Name="Disk Radius",
    Input_21_Hidden=True,
    Input_21_Name="Normal Override",
    Input_2_Hidden=False,
    Input_2_Name="Id"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)
scenelayer = ConstructCSSceneLayer(
    Name="WALL",
    Material=material_3,
    Geometry=flatten(walls),
    Input_0_Hidden=False,
    Input_0_Name="Name",
    Input_1_Hidden=False,
    Input_1_Name="Material",
    Input_2_Hidden=False,
    Input_2_Name="Geometry",
    Input_3_Hidden=True,
    Input_3_Name="ViewTag",
    UnitSystem=4,
    Input_3_GHParam_Branch0_Path="{0}",
    Input_3_GHParam_Branch0_Item0_null_string=False,
    Input_3_GHParam_Branch0_Item0_string="None")
scenelayer_2 = ConstructCSSceneLayer(
    Name="CEILING",
    Material=material,
    Geometry=ceiling,
    Input_0_Hidden=False,
    Input_0_Name="Name",
    Input_1_Hidden=False,
    Input_1_Name="Material",
    Input_2_Hidden=False,
    Input_2_Name="Geometry",
    Input_3_Hidden=True,
    Input_3_Name="ViewTag",
    UnitSystem=4,
    Input_3_GHParam_Branch0_Path="{0}",
    Input_3_GHParam_Branch0_Item0_null_string=False,
    Input_3_GHParam_Branch0_Item0_string="None")
scenelayer_3 = ConstructCSSceneLayer(
    Name="FLOOR",
    Material=material_2,
    Geometry=floor,
    Input_0_Hidden=False,
    Input_0_Name="Name",
    Input_1_Hidden=False,
    Input_1_Name="Material",
    Input_2_Hidden=False,
    Input_2_Name="Geometry",
    Input_3_Hidden=True,
    Input_3_Name="ViewTag",
    UnitSystem=4,
    Input_3_GHParam_Branch0_Path="{0}",
    Input_3_GHParam_Branch0_Item0_null_string=False,
    Input_3_GHParam_Branch0_Item0_string="None")
# Surfaces added to the Window component
# should not also be added to SceneLayers.
window = ConstructCSWindow(
    Glazing=glazing,
    Surface=flatten(windows),
    Input_0_Hidden=False,
    Input_0_Name="Glazing",
    Input_1_Hidden=True,
    Input_1_Name="WovenShade",
    Input_2_Hidden=True,
    Input_2_Name="Position",
    Input_3_Hidden=True,
    Input_3_Name="Rotation",
    Input_4_Hidden=True,
    Input_4_Name="Position Schedule",
    Input_5_Hidden=True,
    Input_5_Name="Rotation Schedule",
    Input_6_Hidden=True,
    Input_6_Name="ECGlass",
    Input_7_Hidden=True,
    Input_7_Name="Tint",
    Input_8_Hidden=True,
    Input_8_Name="Tint Schedule",
    Input_9_Hidden=False,
    Input_9_Name="Surface",
    Mode=2,
    UnitSystem=4)
data = Data(flatten([scenelayer_2, scenelayer_3, scenelayer]))
daylightmodel = ConstructCSDaylightModel(
    SceneLayers=data,
    Windows=window,
    SensorGrids=grid,
    NorthOffset=0,
    Input_0_Hidden=False,
    Input_0_Name="SceneLayers",
    Input_1_Hidden=False,
    Input_1_Name="Windows",
    Input_2_Hidden=False,
    Input_2_Name="Luminaires",
    Input_3_Hidden=True,
    Input_3_Name="Tubular Devices",
    Input_4_Hidden=False,
    Input_4_Name="SensorGrids",
    Input_5_Hidden=False,
    Input_5_Name="Camera",
    Input_6_Hidden=False,
    Input_6_Name="North Offset",
    UnitSystem=4)
run = ClusterInput()  # Run
daylight = RunCSDaylight(
    Name="FloorPlan\LEED Daylight",
    Model=daylightmodel,
    WeatherFile="USA_MA_Boston-Logan.Intl.AP.725090_TMYx.2004-2018",
    Samples=4096,
    SaveHourly=False,
    Run=run,
    Input_0_Hidden=False,
    Input_0_Name="Name",
    Input_10_Hidden=False,
    Input_10_Name="Run",
    Input_1_Hidden=False,
    Input_1_Name="Model",
    Input_2_Hidden=True,
    Input_2_Name="BldgType",
    Input_3_Hidden=False,
    Input_3_Name="WeatherFile",
    Input_4_Hidden=True,
    Input_4_Name="Ground Albedo",
    Input_5_Hidden=False,
    Input_5_Name="Samples",
    Input_6_Hidden=False,
    Input_6_Name="Save Hourly",
    Input_7_Hidden=True,
    Input_7_Name="Threads",
    Input_8_Hidden=True,
    Input_8_Name="Hide Pop-up",
    Input_9_Hidden=True,
    Input_9_Name="Radiance Params",
    Standard=0,
    UnitSystem=4,
    Input_2_GHParam_Branch0_Path="{0}",
    Input_2_GHParam_Branch0_Item0_null_string=False,
    Input_2_GHParam_Branch0_Item0_string="Office",
    Input_4_GHParam_Branch0_Path="{0}",
    Input_4_GHParam_Branch0_Item0_number=0.2,
    Input_7_GHParam_Branch0_Path="{0}",
    Input_7_GHParam_Branch0_Item0_number=0,
    Input_8_GHParam_Branch0_Path="{0}",
    Input_8_GHParam_Branch0_Item0_boolean=False,
    Input_9_GHParam_Branch0_Path="{0}",
    Input_9_GHParam_Branch0_Item0_null_string=False,
    Input_9_GHParam_Branch0_Item0_string="-ab 6 -lw 0.01")
csr = LoadCSResult(
    Result=daylight,
    Header=False,
    Output_0_Hidden=False,
    Output_0_Name="Name",
    Output_10_Hidden=True,
    Output_10_Name="Weather",
    Output_11_Hidden=True,
    Output_11_Name="North",
    Output_12_Hidden=True,
    Output_12_Name="LayerNames",
    Output_13_Hidden=True,
    Output_13_Name="LayerObjects",
    Output_14_Hidden=True,
    Output_14_Name="LayerMaterials",
    Output_15_Hidden=True,
    Output_15_Name="Sky",
    Output_1_Hidden=False,
    Output_1_Name="Type",
    Output_2_Hidden=True,
    Output_2_Name="Standard",
    Output_3_Hidden=True,
    Output_3_Name="Date",
    Output_4_Hidden=True,
    Output_4_Name="Version",
    Output_5_Hidden=True,
    Output_5_Name="FileSize",
    Output_6_Hidden=True,
    Output_6_Name="RunLog",
    Output_7_Hidden=False,
    Output_7_Name="Metrics",
    Output_8_Hidden=False,
    Output_8_Name="MetricValues",
    Output_9_Hidden=False,
    Output_9_Name="Grids",
    UnitSystem=4)  # -> Name, Type, Metrics, MetricValues, Grids
lng = ListLength(List=csr.Metrics)
item = ListItem(List=csr.MetricValues, Index="1", Wrap=True)  # -> flatten(Item)
grid_preview = ClusterOutput(csr.Grids)  # Grid(Preview)
dup = DuplicateData(Data="************************", Number=lng, Order=True)
weave = Weave(Pattern=[0, 1, 2], Stream0=dup, Stream1=csr.Metrics, Stream2=csr.MetricValues, NullGaps=False)
type_casting_c = CSharpScript(x=item)  # -> out, A; inputs x: String
# ---------- type_casting_c: C# ----------
    A = float.Parse(x);
# ---------- end type_casting_c ----------
metrics = Panel(weave)
spatial_daylight_autonomy = ClusterOutput(type_casting_c.A)  # Spatial Daylight Autonomy

# ==== cluster Cluster
swatch = ColourSwatch(SwatchColor=RGB(255, 255, 255))
c_script = CSharpScript(switcher=Toggle(True), canvas_back=swatch, canvas_grid=swatch)  # -> out, A; inputs switcher: Boolean, canvas_back: Color, canvas_grid: Color
# ---------- c_script: C# ----------
    {
      if (switcher == true)
      {
        Grasshopper.GUI.Canvas.GH_Skin.canvas_grid = canvas_grid;
        Grasshopper.GUI.Canvas.GH_Skin.canvas_back = canvas_back;
        Grasshopper.GUI.Canvas.GH_Skin.canvas_edge = System.Drawing.Color.FromArgb(255, 0, 0, 0);
        Grasshopper.GUI.Canvas.GH_Skin.canvas_shade = System.Drawing.Color.FromArgb(80, 0, 0, 0);
      }
      else
      {
        //DEFAULTS
        Grasshopper.GUI.Canvas.GH_Skin.canvas_grid = System.Drawing.Color.FromArgb(30, 0, 0, 0);
        Grasshopper.GUI.Canvas.GH_Skin.canvas_back = System.Drawing.Color.FromArgb(255, 212, 208, 200);
        Grasshopper.GUI.Canvas.GH_Skin.canvas_edge = System.Drawing.Color.FromArgb(255, 0, 0, 0);
        Grasshopper.GUI.Canvas.GH_Skin.canvas_shade = System.Drawing.Color.FromArgb(80, 0, 0, 0);
      }
    }
# ---------- end c_script ----------

# ==== cluster InternalGeometry
F = ClusterInput()
F_2 = Number(F)
mullion = Brep([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])
glazing = Brep([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])
ceiling = Brep(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)
floor = Brep(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)
wall = Brep([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])
grid = Brep([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])
scale = Scale(Geometry=ceiling, Center=Point(0, 0, 0), Factor=F_2)  # -> Geometry, Transform
scale_2 = Scale(Geometry=floor, Center=Point(0, 0, 0), Factor=F_2)  # -> Geometry, Transform
scale_3 = Scale(Geometry=mullion, Center=Point(0, 0, 0), Factor=F_2)  # -> Geometry, Transform
scale_4 = Scale(Geometry=wall, Center=Point(0, 0, 0), Factor=F_2)  # -> Geometry, Transform
scale_5 = Scale(Geometry=glazing, Center=Point(0, 0, 0), Factor=F_2)  # -> Geometry, Transform
scale_6 = Scale(Geometry=grid, Center=Point(0, 0, 0), Factor=F_2)  # -> Geometry, Transform
floor_2 = Brep(scale_2.Geometry)
wall_2 = Brep(scale_4.Geometry)
grid_2 = Brep(scale_6.Geometry)
ceiling_2 = Brep(scale.Geometry)
glazing_2 = Brep(scale_5.Geometry)
mullion_2 = Brep(scale_3.Geometry)
ceiling_3 = ClusterOutput(ceiling_2)
floor_3 = ClusterOutput(floor_2)
mullion_3 = ClusterOutput(mullion_2)
wall_3 = ClusterOutput(wall_2)
glazing_3 = ClusterOutput(glazing_2)
grid_3 = ClusterOutput(grid_2)
